# Grasshopper definition ameba_cantilever_2D.gh (Grasshopper 1.0.7)
# plug-ins: Ameba2

brep = Brep(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)
mp = MeshParting(
    Brep=flatten(brep),
    ProjectName="cantilever3",
    Size=Slider(0.3, range=0..1),
    Mesh_PartingElementFamily=0,
    Mesh_PartingFemCoordinateSystem=0)  # -> AmebaGeo, Boundary, Log
load2dcurve = Load2dCurve(AmebaGeo=mp.AmebaGeo, X=0, Y="-1")
support2dcurve = Support2dCurve(AmebaGeo=mp.AmebaGeo, U1="0", U2="0")
ml = MultipleLoadCase(Load=flatten(load2dcurve), Boundary=flatten(support2dcurve))
preprocessing = PreProcessing(AmebaGeo=mp.AmebaGeo, MultipleLoadCase=flatten(ml), preprocessing_setting="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")  # -> PreprocessInfo, AmebaGeo
solver = Solver(Info=preprocessing.PreprocessInfo)
display = Display(AmebaGeo=mp.AmebaGeo, Step=Slider(45, range=0..100), Scale=0, CaseIndex=0, Linear=False, displayColor=0, flip_mark=False)  # -> Mesh, SmoothMesh, KeepCell, Value
