# Grasshopper definition ameba_museum_3D.gh (Grasshopper 1.0.7)
# plug-ins: Ameba2

roof = Brep(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)
ramp = Brep(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)
Z = UnitZ(Factor="-12")
brep = Brep(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)
extr = Extrude(Base=roof, Direction=Z)
extr_2 = Extrude(Base=ramp, Direction=Z)
mp = MeshParting(Brep=flatten(brep), ProjectName="museum5", Size="6", Mesh_PartingElementFamily=0, Mesh_PartingFemCoordinateSystem=0)  # -> AmebaGeo, Boundary, Log
brep_2 = Brep(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)
mesh = MeshBrep(
    Brep=extr_2,
    Settings={GridMaxCount=0, GridMinCount=16, JaggedSeams=False, MaxEdgeLength=0, MinEdgeLength=0.0001, MinTolerance=0, Refine=True, RefineAngle=0, RelativeTolerance=0.65, SimplePlanes=True, Tolerance=0})
mesh_2 = MeshBrep(
    Brep=brep_2,
    Settings={GridMaxCount=0, GridMinCount=16, JaggedSeams=False, MaxEdgeLength=0, MinEdgeLength=0.0001, MinTolerance=0, Refine=True, RefineAngle=0, RelativeTolerance=0.65, SimplePlanes=True, Tolerance=0})
mesh_3 = MeshBrep(
    Brep=extr,
    Settings={GridMaxCount=0, GridMinCount=16, JaggedSeams=False, MaxEdgeLength=0, MinEdgeLength=0.0001, MinTolerance=0, Refine=True, RefineAngle=0, RelativeTolerance=0.65, SimplePlanes=True, Tolerance=0})
inmesh = InMesh(AmebaGeo=mp.AmebaGeo, DomainMesh=flatten(mesh_2), isnode_id=False)
inmesh_2 = InMesh(AmebaGeo=mp.AmebaGeo, DomainMesh=flatten(mesh_3), isnode_id=False)
inmesh_3 = InMesh(AmebaGeo=mp.AmebaGeo, DomainMesh=flatten(mesh), isnode_id=False)
load3dsurface = Load3dSurface(AmebaGeo=mp.AmebaGeo, X=0, Y=0, Z="-1")
load3dsurface_2 = Load3dSurface(AmebaGeo=mp.AmebaGeo, X=0, Y=0, Z="-1")
support3dsurface = Support3dSurface(AmebaGeo=mp.AmebaGeo, U1="0", U2="0", U3="0")
nd = NonDomain(ElementIndex=inmesh_2, IsNon=True)
nd_2 = NonDomain(ElementIndex=inmesh_3, IsNon=True)
nd_3 = NonDomain(ElementIndex=inmesh, IsNon=True)
ml = MultipleLoadCase(Load=flatten([load3dsurface, load3dsurface_2]), Boundary=flatten(support3dsurface))
preprocessing = PreProcessing(
    AmebaGeo=mp.AmebaGeo,
    MultipleLoadCase=flatten(ml),
    MeshDomain=flatten([nd_3, nd, nd_2]),
    preprocessing_setting="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")  # -> PreprocessInfo, AmebaGeo
solver = Solver(Info=preprocessing.PreprocessInfo)
display = Display(AmebaGeo=mp.AmebaGeo, Step=Slider(91, range=0..100), Scale=0, CaseIndex=0, Linear=False, displayColor=0, flip_mark=False)  # -> Mesh, SmoothMesh, KeepCell, Value
renderdisplay = RenderDisplay(Geometry=display.Mesh, IsWire=True)
